# Grasshopper definition Exploding Objects.gh (Grasshopper 1.0.7)
# plug-ins: FemDesign.Grasshopper, ExplodingWhale, BH.UI.Grasshopper

pt = Point(Point(0, 0, 0))
crv = Curve(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)
hinged = PointSupportHinged(Point=pt, Identifier="S")
explode = Explode(Object=hinged, Component="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")  # -> Name, Group, Directed, Position, Motions, MotionsPlasticityLimits, Rotations, RotationsPlasticityLimits, Guid, Action
explode_2 = ExplodingWhale(Object=hinged)  # -> Fields, Values
explode_3 = ExplodingWhale(Object=crv)  # -> Fields, Values
explode_4 = Explode(Object=crv, Component="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")  # -> PointCount, Domain, Dimension, SpanCount, Degree, IsClosed, IsPeriodic, PointAtStart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
panel = Panel(explode_3.Fields)
panel_2 = Panel(explode_3.Values)
